# Grasshopper definition assignment-01.gh (Grasshopper 1.0.8)

# Assignment-01: Bauhaus
scale_base_plate = Slider(10, range=-10..10)
scale_spheres = Slider(3.1, range=-10..10)
move_spheres = Slider(-6, range=-10..10)
scale_stairs = Slider(-0.3, range=-10..10)
move_cubes = Slider(0, range=-10..10)
grid_cubes = Slider(2.5, range=-10..10)
transparent_background = BooleanToggle(False)
colour = ColourPicker(PickedColour=RGB(255, 255, 255))
save_current_view = Button()
capture_view = Button()
set_view = Button()
border_width_in_px = Number(200)
resolution_in_dpi = Number(600)
capture_path = FilePath("C:\Users\Niclas\GitHub\")

# ---- group: Auto-reloads cdf module on VScode changes
path = FilePath("C:\Users\Niclas\GitHub\cdf1_teaching\src\")
autoreloader = Python3Script(
    src_path=path,
    u=scale_base_plate,
    v=scale_spheres,
    w=move_spheres,
    x=scale_stairs,
    y=grid_cubes,
    z=move_cubes,
    g_view=save_current_view,
    s_view=set_view,
    c_path=capture_path,
    c_back=transparent_background,
    c_color=colour,
    c_border=border_width_in_px,
    c_res=resolution_in_dpi,
    c_run=capture_view)  # -> out, a, b, c, d, e; inputs src_path: String
# ---------- autoreloader: Python ----------
#! python3
import sys, os, time
import scriptcontext as sc
import Rhino, System
from System.IO import FileSystemWatcher, NotifyFilters

VERSION = 1  
pkg = "cdf"

if not src_path:
    raise Exception("Connect a folder to src_path.")
path = os.path.normpath(src_path)
watch_dir = os.path.join(path, pkg)
if not os.path.isdir(watch_dir):
    raise Exception("No '{}' folder found in:\n{}".format(pkg, path))

def unload():
    for name in list(sys.modules):
        if name == pkg or name.startswith(pkg + "."):
            del sys.modules[name]

# Put this folder first in Python's search list
if path in sys.path:
    sys.path.remove(path)
sys.path.insert(0, path)

key = "cdf_watcher_" + str(ghenv.Component.InstanceGuid)
time_key = key + "_time"
version_key = key + "_version"

def stamp():
    sc.sticky[time_key] = time.strftime("%Y-%m-%d %H:%M:%S")

# Replace the old watcher if the folder changed or the script was updated
old = sc.sticky.get(key)
if old is not None and (os.path.normpath(old.Path) != watch_dir
                        or sc.sticky.get(version_key) != VERSION):
    old.Dispose()
    del sc.sticky[key]
    unload()

if key not in sc.sticky:
    comp = ghenv.Component
    last = [0.0]

    def reload_and_rerun():
        unload()
        stamp()
        doc = comp.OnPingDocument()
        if doc is None:            # reloader was deleted or the file closed
            return
        for obj in doc.Objects:
            if "Python" in obj.GetType().Name:
                obj.ExpireSolution(False)   # mark as out of date
        doc.NewSolution(False)              # recompute once

    def on_change(sender, e):
        if not e.FullPath.endswith(".py") or "__pycache__" in e.FullPath:
            return
        if time.time() - last[0] < 0.5:     # ignore the second event of a double save
            return
        last[0] = time.time()
        Rhino.RhinoApp.InvokeOnUiThread(System.Action(reload_and_rerun))

    w = FileSystemWatcher(watch_dir, "*.py")
    w.IncludeSubdirectories = True
    w.NotifyFilter = NotifyFilters.LastWrite
    w.Changed += on_change
    w.EnableRaisingEvents = True
    sc.sticky[key] = w
    sc.sticky[version_key] = VERSION
    stamp()                                  # time the watcher started

msg = "Last reloaded: {}\nWatching: {}".format(sc.sticky.get(time_key, "unknown"), watch_dir)
print(msg)
out = msg

# ----------------------------------------

import cdf

a,b,c,d,e = cdf.composition(u,v,w,x,y,z)

if g_view:    
    cdf.getview()

if s_view:
    cdf.setview()

if c_run:
    cdf.caputreview(c_path, c_back, c_color, c_border, c_res)
# ---------- end autoreloader ----------
panel = Panel(autoreloader.out)

# ----
colour_2 = ColourPicker(PickedColour=RGB(186, 43, 43))
colour_3 = ColourPicker(PickedColour=RGB(240, 240, 240))
visible = BooleanToggle(True)
visible_2 = BooleanToggle(True)
object = ModelObject(Object=autoreloader.d, Visibility=visible, Display=colour_2, Render=colour_2)
object_2 = ModelObject(Object=autoreloader.a, Visibility=visible_2, Display=colour_3, Render=colour_3)
colour_4 = ColourPicker(PickedColour=RGB(243, 255, 77))
colour_5 = ColourPicker(PickedColour=RGB(0, 0, 0))
visible_3 = BooleanToggle(True)
visible_4 = BooleanToggle(True)
object_3 = ModelObject(Object=autoreloader.b, Visibility=visible_3, Display=colour_5, Render=colour_5)
object_4 = ModelObject(Object=autoreloader.e, Visibility=visible_4, Display=colour_4, Render=colour_4)
colour_6 = ColourPicker(PickedColour=RGB(51, 87, 245))
visible_5 = BooleanToggle(True)
object_5 = ModelObject(Object=autoreloader.c, Visibility=visible_5, Display=colour_6, Render=colour_6)
merge = Merge(Data1=object_2, Data2=object_3, Data3=object_5, Data4=object, Data5=object_4)
update = BooleanToggle(True)
cache = ContentCache(Content=merge, Action=update)
